# Dynamo graph QuadTriangleRepresentation.dyn (Dynamo 2.0.0.4355)

integer_slider = IntegerSlider(10, range=0..20 step 1)

# group: Custom IGraphic Display Class
quad_vertices = CodeBlock(z=integer_slider)
# ---------- quad_vertices.designscript (4 lines) ----------
Vector.ByCoordinates(0,0,z);
Vector.ByCoordinates(10,0,20);
Vector.ByCoordinates(10,10,10);
Vector.ByCoordinates(0,10,10);
# ----------------------------------------
createQuadMesh = Examples.CustomMeshRendering.CreateQuadMesh(a=quad_vertices.out0, b=quad_vertices.out1, c=quad_vertices.out2, d=quad_vertices.out3)

# group: ASM
code_block = CodeBlock(z=integer_slider)
# ---------- code_block.designscript (6 lines) ----------
a = Point.ByCoordinates(10,0,z);
b = Point.ByCoordinates(20,0,20);
c = Point.ByCoordinates(20,10,10);
d = Point.ByCoordinates(10,10,10);

verts = [a,b,c,d];
# ----------------------------------------
code_block_2 = CodeBlock { 0; 1; 2; 3; }
byIndices = IndexGroup.ByIndices(a=code_block_2.out0, b=code_block_2.out1, c=code_block_2.out2, d=code_block_2.out3)
byPointsFaceIndices = Mesh.ByPointsFaceIndices(vertexPositions=code_block.verts, indices=byIndices)

# group: Conversion Logic
quad_vertices_2 = CodeBlock()
# ---------- quad_vertices_2.designscript (7 lines) ----------
// quad
p1 = Point.ByCoordinates(0,0,0);
p2 = Point.ByCoordinates(10,0,0);
p3 = Point.ByCoordinates(10,10,0);
p4 = Point.ByCoordinates(0,10,0);

points = [p1, p2, p3, p4];
# ----------------------------------------
code_block_3 = CodeBlock(points=quad_vertices_2.points)
# ---------- code_block_3.designscript (11 lines) ----------
// triangle 1
a = points[0];
b = points[1];
c = points[2];
t1 = [a, b, c];

// triangle 2
d = points[2];
e = points[3];
f = points[0];
t2 = [d, e, f];
# ----------------------------------------
code_block_4 = CodeBlock { [0, 1, 2]; }

# group: MeshToolkit
byVerticesAndIndices = Autodesk.Dynamo.MeshToolkit.Mesh.ByVerticesAndIndices(vertices=code_block_3.t1, indices=code_block_4)
edges = Autodesk.Dynamo.MeshToolkit.Mesh.Edges(mesh=byVerticesAndIndices)
byVerticesAndIndices_2 = Autodesk.Dynamo.MeshToolkit.Mesh.ByVerticesAndIndices(vertices=code_block_3.t2, indices=code_block_4)
edges_2 = Autodesk.Dynamo.MeshToolkit.Mesh.Edges(mesh=byVerticesAndIndices_2)
